% Requirement links of CRUISE_CONTROL_APPLICATION.slx (R2021b)

block :9 implements Requirement Document.docx#@Simulink_requirement_item_3: A. Cruise Control: https://ctms.engin.umich.edu/CTMS/index.php?example=CruiseControl&section=Simulink%20Modeling Tune the Kp, Ki and Kd gains for the PID controller as per the requirements. Rise time < 10s Overshoot < 10% Steady-state error < 1%