% Requirement links of DC_MOTOR_CONTROL_APPLICATION.slx (R2021b)

block :14 implements Requirement Document.docx#@Simulink_requirement_item_4: B. Motor Speed Control: https://ctms.engin.umich.edu/CTMS/index.php?example=MotorSpeed&section=SimulinkM%20odeling Tune the Kp, Ki and Kd gains for the PID controller as per the requirements. Rise time < 5s Overshoot < 5% Steady-state error < 1%